# Grasshopper definition 09_Bookcase.gh (Grasshopper 1.0.8)
# Copyright: Copyright © 2024 DataB Gmbh
# plug-ins: ggRhinoIFC

default_5 = Integer(5)
default_0 = Integer(0)
_1 = Integer(1)
_2 = Number(2)
_0 = Number(0)
_2b = Number(2)
_3 = Number(3)
default_900_mm_100_0_5000_0 = Slider(900, range=100..5000)
width = GetNumber(
    default_900_mm_100_0_5000_0,
    AtLeast=1,
    AtMost=1,
    Maximum=1.797693135e+308,
    Minimum=-1.797693135e+308,
    Prompt="Width (100 mm to 5000 mm)",
    TreeAccess=False)
default_1800_mm_100_0_4000_0 = Slider(1800, range=100..4000)
height = GetNumber(
    default_1800_mm_100_0_4000_0,
    AtLeast=1,
    AtMost=1,
    Maximum=1.797693135e+308,
    Minimum=-1.797693135e+308,
    Prompt="Height (100 mm to 4000 mm)",
    TreeAccess=False)
default_320_mm_80_0_2000_0 = Slider(320, range=80..2000)
depth = GetNumber(
    default_320_mm_80_0_2000_0,
    AtLeast=1,
    AtMost=1,
    Maximum=1.797693135e+308,
    Minimum=-1.797693135e+308,
    Prompt="Depth (80 mm to 2000 mm)",
    TreeAccess=False)
default_18_mm_3_0_60_0 = Slider(18, range=3..60)
board_thickness = GetNumber(
    default_18_mm_3_0_60_0,
    AtLeast=1,
    AtMost=1,
    Maximum=1.797693135e+308,
    Minimum=-1.797693135e+308,
    Prompt="Board Thickness (3 mm to 60 mm)",
    TreeAccess=False)
shelves = GetInteger(default_5, AtLeast=1, AtMost=1, Maximum=2147483647, Minimum=-2147483648, Prompt="Shelves (0 to 24)", TreeAccess=False)
vertical_dividers = GetInteger(
    default_0,
    AtLeast=1,
    AtMost=1,
    Maximum=2147483647,
    Minimum=-2147483648,
    Prompt="Vertical Dividers (0 to 24)",
    TreeAccess=False)
default_on = BooleanToggle(True)
back_panel = GetBoolean(default_on, AtLeast=1, AtMost=1, FalseValue="False", Prompt="Back Panel", TreeAccess=False, TrueValue="True")
default_6_mm_2_0_30_0 = Slider(6, range=2..30)
back_thickness = GetNumber(
    default_6_mm_2_0_30_0,
    AtLeast=1,
    AtMost=1,
    Maximum=1.797693135e+308,
    Minimum=-1.797693135e+308,
    Prompt="Back Thickness (2 mm to 30 mm)",
    TreeAccess=False)
default_off = BooleanToggle(False)
front_doors_panels = GetBoolean(default_off, AtLeast=1, AtMost=1, FalseValue="False", Prompt="Front Doors / Panels", TreeAccess=False, TrueValue="True")
default_18_mm_3_0_60_0_2 = Slider(18, range=3..60)
front_thickness = GetNumber(
    default_18_mm_3_0_60_0_2,
    AtLeast=1,
    AtMost=1,
    Maximum=1.797693135e+308,
    Minimum=-1.797693135e+308,
    Prompt="Front Thickness (3 mm to 60 mm)",
    TreeAccess=False)
default_3_mm_1_0_100_0 = Slider(3, range=1..100)
front_clearance = GetNumber(
    default_3_mm_1_0_100_0,
    AtLeast=1,
    AtMost=1,
    Maximum=1.797693135e+308,
    Minimum=-1.797693135e+308,
    Prompt="Front Clearance (1 mm to 100 mm)",
    TreeAccess=False)
subtraction = Subtraction(A=width, B=board_thickness)
subtraction_2 = Subtraction(A=height, B=board_thickness)
left_a = ConstructPoint(XCoordinate=0, YCoordinate=0, ZCoordinate=0)
left_b = ConstructPoint(XCoordinate=board_thickness, YCoordinate=depth, ZCoordinate=height)
left = Box2Pt(PointA=left_a, PointB=left_b, Plane=PlaneXY(0, 0, 0))
right_a = ConstructPoint(XCoordinate=subtraction, YCoordinate=0, ZCoordinate=0)
right_b = ConstructPoint(XCoordinate=width, YCoordinate=depth, ZCoordinate=height)
right = Box2Pt(PointA=right_a, PointB=right_b, Plane=PlaneXY(0, 0, 0))
bottom_a = ConstructPoint(XCoordinate=0, YCoordinate=0, ZCoordinate=0)
bottom_b = ConstructPoint(XCoordinate=width, YCoordinate=depth, ZCoordinate=board_thickness)
bottom = Box2Pt(PointA=bottom_a, PointB=bottom_b, Plane=PlaneXY(0, 0, 0))
top_a = ConstructPoint(XCoordinate=0, YCoordinate=0, ZCoordinate=subtraction_2)
top_b = ConstructPoint(XCoordinate=width, YCoordinate=depth, ZCoordinate=height)
top = Box2Pt(PointA=top_a, PointB=top_b, Plane=PlaneXY(0, 0, 0))
addition = Addition(A=vertical_dividers, B=_1)
_2t = Multiplication(A=board_thickness, B=_2)
innerw = Subtraction(A=width, B=_2t)
vstep = Division(A=innerw, B=addition)
vstart = Addition(A=board_thickness, B=vstep)
vertical_x = Series(Start=vstart, Step=vstep, Count=vertical_dividers)
addition_2 = Addition(A=vertical_x, B=board_thickness)
vertical_a = ConstructPoint(XCoordinate=vertical_x, YCoordinate=0, ZCoordinate=0)
vertical_b = ConstructPoint(XCoordinate=addition_2, YCoordinate=depth, ZCoordinate=height)
verticals = Box2Pt(PointA=vertical_a, PointB=vertical_b, Plane=PlaneXY(0, 0, 0))
addition_3 = Addition(A=shelves, B=_1)
innerh = Subtraction(A=height, B=_2t)
shelf_step = Division(A=innerh, B=addition_3)
shelf_start = Addition(A=board_thickness, B=shelf_step)
shelf_z = Series(Start=shelf_start, Step=shelf_step, Count=shelves)
addition_4 = Addition(A=shelf_z, B=board_thickness)
shelf_a = ConstructPoint(XCoordinate=0, YCoordinate=0, ZCoordinate=shelf_z)
shelf_b = ConstructPoint(XCoordinate=width, YCoordinate=depth, ZCoordinate=addition_4)
shelves_2 = Box2Pt(PointA=shelf_a, PointB=shelf_b, Plane=PlaneXY(0, 0, 0))
d_backt = Subtraction(A=depth, B=back_thickness)
back_a = ConstructPoint(XCoordinate=0, YCoordinate=d_backt, ZCoordinate=0)
back_b = ConstructPoint(XCoordinate=width, YCoordinate=depth, ZCoordinate=height)
back = Box2Pt(PointA=back_a, PointB=back_b, Plane=PlaneXY(0, 0, 0))
back_on_off = Dispatch(List=back, DispatchPattern=back_panel)  # -> ListA, ListB
_3gap = Multiplication(A=front_clearance, B=_3)
door_clear_w = Subtraction(A=width, B=_3gap)
door_w = Division(A=door_clear_w, B=_2b)
y_front = Subtraction(A=_0, B=front_clearance)
y_rear = Subtraction(A=y_front, B=front_thickness)
door1_x2 = Addition(A=front_clearance, B=door_w)
door2_x1 = Addition(A=door1_x2, B=front_clearance)
w_gap = Subtraction(A=width, B=front_clearance)
h_gap = Subtraction(A=height, B=front_clearance)
door1_a = ConstructPoint(XCoordinate=front_clearance, YCoordinate=y_rear, ZCoordinate=front_clearance)
door1_b = ConstructPoint(XCoordinate=door1_x2, YCoordinate=y_front, ZCoordinate=h_gap)
door_1_no_joint = Box2Pt(PointA=door1_a, PointB=door1_b, Plane=PlaneXY(0, 0, 0))
door1_on_off = Dispatch(List=door_1_no_joint, DispatchPattern=front_doors_panels)  # -> ListA, ListB
door2_a = ConstructPoint(XCoordinate=door2_x1, YCoordinate=y_rear, ZCoordinate=front_clearance)
door2_b = ConstructPoint(XCoordinate=w_gap, YCoordinate=y_front, ZCoordinate=h_gap)
door_2_no_joint = Box2Pt(PointA=door2_a, PointB=door2_b, Plane=PlaneXY(0, 0, 0))
door2_on_off = Dispatch(List=door_2_no_joint, DispatchPattern=front_doors_panels)  # -> ListA, ListB
panels = ContextBake(Content=[left, right, bottom, top, verticals, shelves_2, back_on_off.ListA, door1_on_off.ListA, door2_on_off.ListA])
